# Grasshopper definition GHCitySim.ghx (Grasshopper 0.9.76)
# plug-ins: Python Interpreter

panel = Panel("C:\Users\peronato\Desktop\CitySimGH\")
brep = Brep([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])
box = CenterBox(Base=PlaneXY(0, 0, 0), X=1, Y=1, Z=1)
path = FilePath("C:\Users\peronato\Documents\WeatherFiles\Neuchatel-hour.epw")
number_slider = Slider(2, range=0..10)
brep_2 = Brep(box)
bldgprograms = Honeybee_bldgPrograms({"Office": 0, "Retail": 1, "MidriseApartment": 2, "PrimarySchool": 3, "SecondarySchool": 4, "SmallHotel": 5, "LargeHotel": 6, "Hospital": 7, "Outpatient": 8, "Warehouse": 9, "SuperMarket": 10, "FullServiceRestaurant": 11, "QuickServiceRestaurant": 12}, selected="Office")
createhbsrfs = Honeybee_createHBSrfs(geometry=brep_2)  # -> readMe, simplify(HBSurface); plug-in component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
debrep = DeconstructBrep(Brep=brep)  # -> simplify(Faces), Edges, Vertices
epw_to_clim = Ladybug_EpwToClim(epwFile=path, path=panel, Run=Toggle(False))  # -> out, climatefile; plug-in component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
brep_3 = Brep(graft(debrep.Faces))
dim = Dimensions(Surface=brep_3)  # -> UDimension, VDimension
createhbzones = Honeybee_createHBZones(name="test", zoneProgram=bldgprograms, HBSurfaces=flatten(createhbsrfs.HBSurface), isConditioned=True)  # -> readMe, HBZone; plug-in component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
division = Division(A=dim.VDimension, B=number_slider)
division_2 = Division(A=dim.UDimension, B=number_slider)
mesh_uv = MeshSurface(Surface=brep_3, UCount=division_2, VCount=division, Overhang=False, Equalize=False)
faceb = FaceBoundaries(Mesh=mesh_uv)
path_mapper = PathMapper(faceb, source="{A;B;C}", target="{A}")
searchepconstruction = Honeybee_SearchEPConstruction()  # -> EPSelectedConstr; plug-in component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
srf = Surface(simplify(graft(path_mapper)))
crv = Curve(srf)
citysim_loadresults = Honeybee_CitySimLoadResults(path=panel, name="test", geometry=crv, Run=Toggle(False))  # -> SW; plug-in component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
citysim_runsimulation = Honeybee_CitySimRunSimulation(geometry=crv, path=panel, name="test", climatefile=epw_to_clim.climatefile, Solver="C:\CitySim.exe", Run=Toggle(False))  # plug-in component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
exportladybug = Ladybug_ExportLadybug(components="*", targetFolder="C:\Users\peronato\Documents\GitHub\GHCitySim", export=Toggle(False))  # -> readMe; plug-in component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
setepzonecnstr = Honeybee_SetEPZoneConstruction(
    HBZone=createhbzones.HBZone,
    wallEPConstruction="ASHRAE 189.1-2009 EXTWALL MASS CLIMATEZONE 1",
    roofEPConstruction="ASHRAE 189.1-2009 EXTROOF IEAD CLIMATEZONE 1")  # -> simplify(modifiedHBZone); plug-in component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
python = PythonScript(x=crv)  # -> out, a; inputs x: tree
# ---------- python: Python ----------
import rhinoscriptsyntax as rs
 
import clr
clr.AddReference("Grasshopper")
import Grasshopper.Kernel.Data.GH_Path as ghpath
import Grasshopper.DataTree as datatree
 
import System
# ---------- end python ----------
ma = MassAddition(Input=citysim_loadresults)  # -> Result, PartialResults
division_3 = Division(A=ma.Result, B=1000)
bnd = Bounds(Numbers=flatten(division_3))
ladybug = Ladybug_Ladybug()  # -> Vviiiiiiiiiizzz; plug-in component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
honeybee = Honeybee_Honeybee()  # -> Vviiiiiiiiiizzz; plug-in component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
dedomain = DeconstructDomain(Domain=bnd)  # -> Start, End
citysim_checkmaterials = CitySimCheckMaterials(HBZones=setepzonecnstr)  # -> out; inputs HBZones: list of Brep
# ---------- citysim_checkmaterials: Python ----------
#Extract material properties
#GH-Citysim working component


ghenv.Component.Name = "CitySim-CheckMaterials"
ghenv.Component.NickName = 'CitySim-CheckMaterials'
ghenv.Component.Message = 'WORKING COMPONENT'
ghenv.Component.IconDisplayMode = ghenv.Component.IconDisplayMode.application
ghenv.Component.Category = "Honeybee"
ghenv.Component.SubCategory = "09 | Energy | Energy"
#compatibleHBVersion = VER 0.0.56\nFEB_03_2016
#compatibleLBVersion = VER 0.0.59\nFEB_01_2015
ghenv.Component.AdditionalHelpFromDocStrings = "1"


import Rhino as rc
import scriptcontext as sc
import rhinoscriptsyntax as rs
import os
import System
import Grasshopper.Kernel as gh
import math
import shutil
import collections
import subprocess
import copy

rc.Runtime.HostUtils.DisplayOleAlerts(False)


    
lb_preparation = sc.sticky["ladybug_Preparation"]()
hb_reEvaluateHBZones= sc.sticky["honeybee_reEvaluateHBZones"]
hb_hive = sc.sticky["honeybee_Hive"]()
hb_EPScheduleAUX = sc.sticky["honeybee_EPScheduleAUX"]()
hb_EPPar = sc.sticky["honeybee_EPParameters"]()
    

       
def EPConstructionStr(constructionName):
        constructionData = None
        if constructionName in sc.sticky ["honeybee_constructionLib"].keys():
            constructionData = sc.sticky ["honeybee_constructionLib"][constructionName]
        
        if constructionData!=None:
            materials = []
            numberOfLayers = len(constructionData.keys())
            constructionStr = constructionData[0] + ",\n"
            # add the name
            constructionStr =  constructionStr + "  " + constructionName + ",   !- name\n"
            
            for layer in range(1, numberOfLayers):
                if layer < numberOfLayers-1:
                    constructionStr =  constructionStr + "  " + constructionData[layer][0] + ",   !- " +  constructionData[layer][1] + "\n"
                else:
                    constructionStr =  constructionStr + "  " + constructionData[layer][0] + ";   !- " +  constructionData[layer][1] + "\n\n"
                materials.append(constructionData[layer][0])
                
            return materials
        else:
            warning = "Failed to find " + constructionName + " in library."
            print warning
            ghenv.Component.AddRuntimeMessage(gh.GH_RuntimeMessageLevel.Warning, warning)
            return None, None
            
 
def getMaterialProperties(matName):
    if not sc.sticky["honeybee_release"]:
        print "You should first let Honeybee to fly..."
        w = gh.GH_RuntimeMessageLevel.Warning
        ghenv.Component.AddRuntimeMessage(w, "You should first let Honeybee to fly...")
        return -1

    try:
        if not sc.sticky['honeybee_release'].isCompatible(ghenv.Component): return -1
        if sc.sticky['honeybee_release'].isInputMissing(ghenv.Component): return -1
    except:
        warning = "You need a newer version of Honeybee to use this compoent." + \
        " Use updateHoneybee component to update userObjects.\n" + \
        "If you have already updated userObjects drag Honeybee_Honeybee component " + \
        "into canvas and try again."
        w = gh.GH_RuntimeMessageLevel.Warning
        ghenv.Component.AddRuntimeMessage(w, warning)
        return -1
    
    # get the constuction
    try:
        hb_EPMaterialAUX = sc.sticky["honeybee_EPMaterialAUX"]()
    except:
        msg = "Failed to load EP constructions!"
        ghenv.Component.AddRuntimeMessage(w, msg)
        return -1
    
    if sc.sticky.has_key("honeybee_materialLib"):
        result = hb_EPMaterialAUX.decomposeMaterial(matName.upper(), ghenv.Component)
        if result == -1:
            warning = "Failed to find " + matName + " in the Honeybee material library."
            print warning
            ghenv.Component.AddRuntimeMessage(gh.GH_RuntimeMessageLevel.Warning, warning)
        return result
        

    
# call the objects from the lib
thermalZonesPyClasses = hb_hive.callFromHoneybeeHive(_HBZones)



for zone in thermalZonesPyClasses:

        schedules = zone.getCurrentSchedules(True)
        loads = zone.getCurrentLoads(True)
        
                
        for srf in zone.surfaces:

            if srf.EPConstruction != None:
                srf.construction = srf.EPConstruction
                print "Construction:"
                print "\n"
                print srf.construction
                materials = EPConstructionStr(srf.construction)
                for m in materials:
                    print "Material: ", m
                    print "Material properties : ", getMaterialProperties(m)
                    print "\n"
                print "\n"
# ---------- end citysim_checkmaterials ----------
gradient = Gradient(
    LowerLimit=Slider(0, range=0..100),
    UpperLimit=dedomain.End,
    Parameter=division_3,
    stops=[0: RGB(0, 0, 255), 0.499: RGB(255, 255, 0), 1: RGB(255, 0, 0)])
panel_2 = Panel(citysim_checkmaterials)
preview = CustomPreview(Geometry=srf, Shader=gradient)
